# Dynamo graph SampleDynamoExport.dyn (Dynamo 1.2.1.3083)

boolean = BoolSelector(true)
directory_path = Directory("C:\Users\wwong\Desktop")
code_block = CodeBlock { "spectacles"; }
number_slider = DoubleSlider(10, range=0..100 step 0.1)
byLengths = Cuboid.ByLengths(width=number_slider, length=number_slider, height=number_slider)
byGeometry = Autodesk.Dynamo.MeshToolkit.Mesh.ByGeometry(byLengths)
number_slider_2 = DoubleSlider(129.9, range=0..255 step 0.1)
number_slider_3 = DoubleSlider(166.8, range=0..255 step 0.1)
number_slider_4 = DoubleSlider(96.9, range=0..255 step 0.1)
byARGB = Color.ByARGB(r=number_slider_2, g=number_slider_3, b=number_slider_4)
byToolkitMeshAndColor = Spectacles.DynamoExporter.SpectaclesMesh.ByToolkitMeshAndColor(byGeometry, byARGB)
create = List.Create(byToolkitMeshAndColor.out0)
create_2 = List.Create(byToolkitMeshAndColor.out1)
sceneCompiler = Spectacles.DynamoExporter.Spectacles.SceneCompiler(boolean, directory_path, code_block, create, create_2)
watch = Watch(sceneCompiler.out0)
watch_2 = Watch(sceneCompiler.out1)
boolean_2 = BoolSelector(false)
launch = Spectacles.DynamoExporter.Spectacles.Launch(boolean_2)
watch_3 = Watch(byToolkitMeshAndColor.out0)
watch_4 = Watch(byToolkitMeshAndColor.out1)
byMeshColor = Autodesk.Dynamo.MeshToolkit.Display.MeshDisplay.ByMeshColor(byGeometry, byARGB)
